# Grasshopper definition Utilities_Collection of working c# codes.gh (Grasshopper 1.0.7)

# ----
# Exporting frames to a folder(used with kangaroo2 step solver)
file_path = FilePath("C:\Users\User\Desktop\Thesis Drive\Graphics\2_Animation\200430\TestTimerCapture\")
panel = Panel(file_path)
timer = Timer(TimerInterval=6000, Target=c_script)  # disabled
c_script = CSharpScript(iReset=Button(), iStart=Toggle(False), Path=panel, Name="image", iFrames=Slider(1700, range=0..1700))  # -> out; inputs iReset: Boolean, iStart: Boolean, Path: String, Name: String, iFrames: Int32
# ---------- c_script: C# usings ----------
using Rhino.Display;
using System.Threading;
# ---------- c_script: C# ----------
    
    if(iReset) counter = 0;
    
    if(iStart) {
      var view = doc.Views.ActiveView;
      var view_capture = new ViewCapture
        {
          Width = view.ActiveViewport.Size.Width,
          Height = view.ActiveViewport.Size.Height,
          ScaleScreenItems = false,
          DrawAxes = false,
          DrawGrid = false,
          DrawGridAxes = false,
          TransparentBackground = true
          };

      if(counter < iFrames){
        var screenshot = view_capture.CaptureToBitmap(view);
        if(screenshot != null)
        {
          string filename = Path + Name + counter + ".png";
          screenshot.Save(filename, System.Drawing.Imaging.ImageFormat.Png);
          Print("Count: " + counter);
          counter += 1;
        }
      }
    }
# ---------- c_script: C# additional code ----------
  int counter = 0;
# ---------- end c_script ----------
panel_2 = Panel(c_script)

# ----
# A LIST OF C# CODE THAT WORKS
# filter data type of a list
c_script_2 = CSharpScript()  # -> out, A; inputs x: list
# ---------- c_script_2: C# usings ----------
using System.Linq;
# ---------- c_script_2: C# ----------
    //List <double> output = new List<double>{};

    A = getRadius(x);

    //A = output;
# ---------- c_script_2: C# additional code ----------
  public List<double> getRadius(List<object> item)
  {
    return item.OfType<double>().ToList();
  }
# ---------- end c_script_2 ----------

# ----
# Tree branch/data management static function
c_script_3 = CSharpScript()  # -> out, A
# ---------- c_script_3: C# ----------
    //ListOfListsToTree("name of listof list");
# ---------- c_script_3: C# additional code ----------
  static Grasshopper.DataTree<T> ListOfListsToTree<T > (List < List < T >> s){
  Grasshopper.DataTree<T> tree = new DataTree<T>();
  for(int i = 0;i < s.Count; i++){
  tree.AddRange(s[i], new GH_Path(i));
}
      return tree;
    }
# ---------- end c_script_3 ----------

# ----
# Loop/iterate through Data Tree
c_script_4 = CSharpScript()  # -> out, A; inputs x: tree
# ---------- c_script_4: C# ----------
    for(int i = 0; i < x.BranchCount; i++){
      for(int j = 0; j < x.Branch(i).Count; j++){
        
      }
    }
# ---------- end c_script_4 ----------

# ----
# Squish command calling
toggle = BooleanToggle(True)  # disabled
id = Guid(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)  # disabled
python = PythonScript(geo=id, squish=toggle)  # -> out, a; inputs squish: Boolean; disabled
# ---------- python: Python ----------
import rhinoscriptsyntax as rs

if squish:
    rs.Command("_-Squish _SelId %s _Enter _Enter" % geo)
# ---------- end python ----------
toggle_2 = BooleanToggle(False)  # disabled
brep = Brep([<brep referenced from the Rhino model> x3])  # disabled
lng = ListLength(List=brep)  # disabled
panel_3 = Panel("0.5,0.5")  # disabled
id_2 = Guid(brep)  # disabled
series = Series(Start=0, Step=1, Count=lng)  # disabled
python_2 = PythonScript(ids=id_2, squish=toggle_2)  # -> out, squishedObjs; inputs ids: list, squish: Boolean; disabled
# ---------- python_2: Python ----------
import rhinoscriptsyntax as rs
import scriptcontext as sc
import Rhino

if squish:
    sc.doc = Rhino.RhinoDoc.ActiveDoc
    rs.EnableRedraw(False)
    squishedIdsMoved = []
    squishedObjs = []
    echo = False
    for i,id in enumerate(ids):
        rs.Command("_-Squish _SelId %s _Decorate=Yes _Enter _Enter" % id, echo)
        squishedId = rs.FirstObject()
        squishedIdMoved = rs.MoveObject(squishedId, [i*20,0,0])
        squishedIdsMoved.append(squishedIdMoved)
        squishedObj = sc.doc.Objects.Find(squishedIdMoved).Geometry
        squishedObjs.append(squishedObj)
    rs.DeleteObjects(squishedIdsMoved)
    rs.EnableRedraw(True)
    sc.doc = ghdoc
# ---------- end python_2 ----------
evalsrf = EvaluateSurface(Surface=reparameterize(brep), Point=panel_3)  # -> Point, Normal, Frame; disabled
int = Integer(series)  # disabled
tag = TextTag(Location=evalsrf.Point, Text=int)  # disabled
