# Grasshopper definition 200402_Channel Network Study_Moving Agent Node.gh (Grasshopper 1.0.7)
# plug-ins: Topologizer, LunchBox, Weaverbird, Kangaroo2 Components, TT Toolbox

curve = Curve([<curve referenced from the Rhino model> x4])
loft = Loft(Curves=curve, Options={Adjust=False, Closed=False, LoftEnds=0, LoftSimp=0, LoftType=0, Rebuild=10, Refit=0.01})

# ---- group: EVEN!
number_slider = Slider(16, range=0..100)

# ----
srf = Surface(loft)
wires = BrepWireframe(Brep=srf, Density=-1)
trib = TrianglePanelsB(Surface=srf, UDivisions=number_slider, VDivisions=Slider(8, range=0..100))
disc = Discontinuity(Curve=trib, Level=1)  # -> Points, Parameters
triangle = MeshTriangle(CornerA=0, CornerB=1, CornerC=2)
conmesh = ConstructMesh(Vertices=disc.Points, Faces=triangle)
wbjoin = WeaverbirdsJoinMeshesAndWeld(Mesh=flatten(conmesh), Weld=Toggle(True))
unim = UnifyMesh(Mesh=wbjoin)  # -> Result, Count
wbdual = WeaverbirdsDualGraph(MeshCurves=unim.Result, DualMode=0)

mesh = Mesh(<mesh referenced from the Rhino model>)
explode = Explode(Curve=wbdual, Recursive=True)  # -> flatten(Segments), Vertices

remove_duplicate_points = RemoveDuplicatePoints(InputPoints=flatten(explode.Vertices), Tolerance=0.001)  # -> OutputPoints, FirstPointIndexes
boolean_toggle = BooleanToggle(True)
clean_tree = CleanTree(
    RemoveNulls=boolean_toggle,
    RemoveInvalid=boolean_toggle,
    RemoveEmpty=boolean_toggle,
    Tree=remove_duplicate_points.OutputPoints)

deconstruct_mesh = DeconstructMesh(Mesh=mesh)  # -> Vertices, Faces, Colours, Normals

construct_domain = ConstructDomain(DomainStart=Slider(1, range=-1..1), DomainEnd=Slider(-1.2, range=-6..3))

split_ahsl = SplitAHSL(Colour=deconstruct_mesh.Colours)  # -> Alpha, Hue, Saturation, Luminance
bounds = Bounds(Numbers=split_ahsl.Luminance)
remap_numbers = RemapNumbers(Value=split_ahsl.Luminance, Source=bounds, Target=construct_domain)  # -> Mapped, Clipped
point_charge = PointCharge(Point=deconstruct_mesh.Vertices, Charge=remap_numbers.Mapped, Decay=2)
merge_fields = MergeFields(Fields=point_charge)

brep = Brep([<brep referenced from the Rhino model> x4])
point_in_breps = PointInBreps(Brep=brep, Point=clean_tree, Strict=False)  # -> Inside, Index
cull_pattern = CullPattern(List=clean_tree, CullPattern=point_in_breps.Inside)

evaluate_field = EvaluateField(Field=merge_fields, Point=clean_tree)  # -> Tensor, Strength
number_slider_2 = Slider(0.22, range=0..1)
amplitude = Amplitude(Vector=evaluate_field.Tensor, Amplitude=Slider(1, range=0..1))
hingepoints = HingePoints(Mesh=unim.Result)  # -> _1, _2, _3, _4
length_line = LengthLine(Line=explode.Segments, Strength=Slider(146, range=0..1000))
nofoldthrough = NoFoldThrough(
    FoldStart=hingepoints._1,
    FoldEnd=hingepoints._2,
    Tip1=hingepoints._3,
    Tip2=hingepoints._4,
    Strength=Slider(1000, range=0..1000))
load = Load(Point=clean_tree, ForceVector=amplitude)
onmesh = OnMesh(Points=clean_tree, Mesh=mesh, Strength=Slider(925, range=0..1000))
anchor = Anchor(Point=flatten(cull_pattern), Strength=Slider(1000, range=0..1000))
spherecollide = SphereCollide(Points=clean_tree, Radius=number_slider_2, Strength=Slider(112, range=0..1000))
show = Show(G=clean_tree)
show_2 = Show(G=explode.Segments)

number_slider_3 = Slider(25, range=0..100)  # disabled
number_slider_4 = Slider(25, range=0..100)  # disabled
curve_2 = Curve([<curve referenced from the Rhino model> x4])  # disabled
loft_2 = Loft(Curves=curve_2, Options={Adjust=False, Closed=False, LoftEnds=0, LoftSimp=0, LoftType=0, Rebuild=10, Refit=0.01})  # disabled
mesh_surface = MeshSurface(Surface=loft_2, UCount=number_slider_4, VCount=number_slider_3, Overhang=True, Equalize=False)  # disabled
number_slider_5 = Slider(13, range=0..40)  # disabled
number_slider_6 = Slider(12, range=0..30)  # disabled
# I used kangaroo to create flexible line connectors and then
# shift the points according to the colour mesh(from millipede) to respective area.
# In this case, I gathered higher density in the stiffer area(white)
# This is done using field attractor.
# logic should be refined further. multiple colour field maybe.
number_slider_7 = Slider(406, range=0..1000)  # disabled
number_slider_8 = Slider(500, range=0..1000)  # disabled
hexagon_cells = HexagonCells(Surface=loft_2, UDivisions=number_slider_6, VDivisions=number_slider_5, TParameter=0.25)  # -> HexagonCells, Centers; disabled
discontinuity = Discontinuity(Curve=hexagon_cells.HexagonCells, Level=1)  # -> Points, Parameters; disabled
populate_geometry = PopulateGeometry(Geometry=loft_2, Count=number_slider_8, Seed=number_slider_7)  # disabled
explode_2 = Explode(Curve=hexagon_cells.HexagonCells, Recursive=True)  # -> flatten(Segments), Vertices; disabled
remove_duplicate_points_2 = RemoveDuplicatePoints(InputPoints=flatten(explode_2.Vertices), Tolerance=0.001)  # -> OutputPoints, FirstPointIndexes; disabled
boolean_toggle_2 = BooleanToggle(True)  # disabled
brep_2 = Brep([<brep referenced from the Rhino model> x8])  # disabled
clean_tree_2 = CleanTree(
    RemoveNulls=boolean_toggle_2,
    RemoveInvalid=boolean_toggle_2,
    RemoveEmpty=boolean_toggle_2,
    Tree=remove_duplicate_points_2.OutputPoints)  # disabled
length = Length(Curve=explode_2.Segments)  # disabled
point_in_breps_2 = PointInBreps(Brep=brep_2, Point=clean_tree_2, Strict=False)  # -> Inside, Index; disabled
number_slider_9 = Slider(0.3, range=0..1)  # disabled
number_slider_10 = Slider(0.11, range=0..1)  # disabled
number_slider_11 = Slider(671, range=0..1000)  # disabled
number_slider_12 = Slider(250, range=0..1000)  # disabled
number_slider_13 = Slider(1000, range=0..1000)  # disabled
cull_pattern_2 = CullPattern(List=clean_tree_2, CullPattern=point_in_breps_2.Inside)  # disabled
mesh_2 = Mesh(<mesh referenced from the Rhino model>)  # disabled
number_slider_14 = Slider(925, range=0..1000)  # disabled
number_slider_15 = Slider(250, range=0..1000)  # disabled
imagecircles = ImageCircles(Points=clean_tree_2, Mesh=mesh_2, Min=number_slider_9, Max=number_slider_10, Strength=number_slider_11)  # disabled
length_line_2 = LengthLine(Line=explode_2.Segments, Strength=number_slider_12)  # disabled
anchor_2 = Anchor(Point=flatten(cull_pattern_2), Strength=number_slider_13)  # disabled
onmesh_2 = OnMesh(Points=clean_tree_2, Mesh=mesh_2, Strength=number_slider_14)  # disabled
show_3 = Show(G=explode_2.Segments)  # disabled
show_4 = Show(G=clean_tree_2)  # disabled
boolean_toggle_3 = BooleanToggle(False)  # disabled
button = Button()  # disabled
boolean_toggle_4 = BooleanToggle(True)  # disabled
number_slider_16 = Slider(9, range=0..10)  # disabled
number_slider_17 = Slider(0, range=0..100)  # disabled

number_slider_18 = Slider(1.8, range=0..10)  # disabled
multiplication = Multiplication(A=length, B=number_slider_18)  # disabled

number_slider_19 = Slider(0.71, range=0..1)  # disabled
multiplication_2 = Multiplication(A=length, B=number_slider_19)  # disabled

clamplength = ClampLength(Line=explode_2.Segments, LowerLimit=multiplication_2, UpperLimit=multiplication, Strength=number_slider_15)  # disabled
merge = Merge(Data1=show_3, Data2=show_4, Data3=clamplength, Data4=onmesh_2, Data5=imagecircles, Data6=anchor_2)  # disabled
solver = Solver(GoalObjects=flatten(merge), Reset=button, Threshold=1e-15, Tolerance=0.01, On=boolean_toggle_3)  # -> I, V, O; disabled
point = Point(solver.O)  # disabled
clean_tree_3 = CleanTree(RemoveNulls=boolean_toggle_4, RemoveInvalid=boolean_toggle_4, RemoveEmpty=boolean_toggle_4, Tree=point)  # disabled
mesh_closest_point = MeshClosestPoint(Point=clean_tree_3, Mesh=mesh_2)  # -> Point, Index, Parameter; disabled
geometry = Geometry(solver.O)  # disabled
curve_3 = Curve(solver.O)  # disabled
mesh_eval = MeshEval(Mesh=mesh_2, Parameter=mesh_closest_point.Parameter)  # -> Point, Normal, Colour; disabled
c_script = CSharpScript(x=solver.O)  # -> out, A; inputs x: list; disabled
# ---------- c_script: C# usings ----------
using System.Linq;
# ---------- c_script: C# ----------
    //List <double> output = new List<double>{};

    A = getRadius(x);

    //A = output;
# ---------- c_script: C# additional code ----------
  public List<double> getRadius(List<object> item)
  {
    return item.OfType<double>().ToList();
  }
# ---------- end c_script ----------
circle_cnr = CircleCNR(Center=clean_tree_3, Normal=mesh_eval.Normal, Radius=c_script.A)  # disabled
closest_points = ClosestPoints(Point=clean_tree_3, Cloud=clean_tree_3, Count=number_slider_16)  # -> ClosestPoint, CPIndex, Distance; disabled
sort_list = SortList(Keys=closest_points.Distance, ValuesValuesA=closest_points.ClosestPoint)  # -> Keys, ValuesValuesA; disabled
cull_index = CullIndex(List=sort_list.ValuesValuesA, Indices=number_slider_17, Wrap=True)  # disabled
line = Line(StartPoint=graft(clean_tree_3), EndPoint=cull_index)  # disabled

length_2 = Length(Curve=explode.Segments)

multiplication_3 = Multiplication(A=length_2, B=Slider(0.3, range=0..1))

multiplication_4 = Multiplication(A=length_2, B=Slider(1, range=0..1.5))

clamplength_2 = ClampLength(Line=explode.Segments, LowerLimit=multiplication_3, UpperLimit=multiplication_4, Strength=Slider(892, range=0..1000))

merge_2 = Merge(
    Data1=show_2,
    Data2=show,
    Data3=clamplength_2,
    Data4=onmesh,
    Data5=spherecollide,
    Data6=anchor,
    Data7=load,
    Data8=nofoldthrough)
solver_2 = Solver(GoalObjects=flatten(merge_2), Reset=Button(), Threshold=1e-15, Tolerance=0.01, On=Toggle(False))  # -> I, V, O
curve_4 = Curve(solver_2.O)

number_slider_20 = Slider(0.15, range=0..1)  # disabled
topologizer = Topologizer(LinesInput=curve_4, Tolerance=number_slider_20)  # -> Lines, Points, LineStart, LineStart_2, Neighbours, Incoming, Outgoing, Graph; disabled

pipe = Pipe(Curve=curve_4, Radius=Slider(0.07, range=0..1), Caps=0)

c_script_2 = CSharpScript(x=solver_2.O)  # -> out, A; inputs x: list; disabled; same code as c_script

boolean_toggle_5 = BooleanToggle(True)
point_2 = Point(solver_2.O)
clean_tree_4 = CleanTree(RemoveNulls=boolean_toggle_5, RemoveInvalid=boolean_toggle_5, RemoveEmpty=boolean_toggle_5, Tree=point_2)

mesh_sphere = MeshSphere(Base=clean_tree_4, Radius=number_slider_2, UCount=10, VCount=20)
