# Grasshopper definition 200413_Inflatable_Saddle.gh (Grasshopper 1.0.7)
# plug-ins: MeshEdit Components, Pufferfish, Exoskeleton2, Fattener, Kangaroo Components, PlanktonGh, LunchBox, Millipede, Weaverbird, Kangaroo2 Components

curve = Curve([<curve referenced from the Rhino model> x2])
curve_2 = Curve([<curve referenced from the Rhino model> x2])
list_item = ListItem(List=curve, Index=0, Wrap=True)  # -> Item, Item1
sweep2 = Sweep2(Rail1=list_item.Item, Rail2=list_item.Item1, Sections=curve_2, SameHeight=False)

# ---- group: EVEN!
number_slider = Slider(6, range=0..100)

# ----
srf = Surface(sweep2)
wires = BrepWireframe(Brep=srf, Density=-1)
trib = TrianglePanelsB(Surface=srf, UDivisions=number_slider, VDivisions=Slider(8, range=0..100))
disc = Discontinuity(Curve=trib, Level=1)  # -> Points, Parameters
triangle = MeshTriangle(CornerA=0, CornerB=1, CornerC=2)
conmesh = ConstructMesh(Vertices=disc.Points, Faces=triangle)
wbjoin = WeaverbirdsJoinMeshesAndWeld(Mesh=flatten(conmesh), Weld=Toggle(True))
unim = UnifyMesh(Mesh=wbjoin)  # -> Result, Count
wbdual = WeaverbirdsDualGraph(MeshCurves=unim.Result, DualMode=0)

mesh_surface = MeshSurface(Surface=sweep2, UCount=Slider(30, range=0..100), VCount=Slider(38, range=0..100), Overhang=True, Equalize=False)
mesh_edges = MeshEdges(Mesh=mesh_surface)  # -> NakedEdges, InteriorEdges, NonManifoldEdges

explode = Explode(Curve=wbdual, Recursive=True)  # -> flatten(Segments), Vertices
removeduplicatelines = RemoveDuplicateLines(Lines=explode.Segments, Tolerance=0.01)
curve_3 = Curve(removeduplicatelines)

number_slider_2 = Slider(0.06, range=0..0.1)  # disabled
number_slider_3 = Slider(0.03, range=0..0.1)  # disabled
number_slider_4 = Slider(2, range=0..10)  # disabled
number_slider_5 = Slider(0.63, range=0..10)  # disabled
exowireframe = ExoWireframe(
    Lines=curve_3,
    Sides=number_slider_4,
    StartRadius=number_slider_5,
    EndRadius=number_slider_5,
    NodeDepth=number_slider_3,
    Division=number_slider_2,
    Open=True)  # disabled

curve_4 = Curve(curve_3)

number_slider_6 = Slider(0, range=0..0.1)
length = Length(Curve=curve_4)
list_length = ListLength(List=curve_4)
duplicate_data = DuplicateData(Data=number_slider_6, Number=list_length, Order=True)
subtraction = Subtraction(A=length, B=number_slider_6)
merge = Merge(Data1=simplify(graft(subtraction)), Data2=simplify(graft(duplicate_data)))
evaluate_length = EvaluateLength(Curve=graft(curve_4), Length=merge, Normalized=False)  # -> Point, Tangent, Parameter
shatter = Shatter(Curve=graft(curve_4), Parameters=evaluate_length.Parameter)
list_item_2 = ListItem(List=shatter, Index=Slider(1, range=0..1), Wrap=True)

surface = Surface(srf)
point_on_curve = PointOnCurve(list_item_2, parameter=0.5)
end_points = EndPoints(Curve=list_item_2)  # -> Start, End
surface_closest_point = SurfaceClosestPoint(Point=point_on_curve, Surface=surface)  # -> Point, UVPoint, Distance
vector_2pt = Vector2Pt(PointA=end_points.Start, PointB=end_points.End, Unitize=False)  # -> Vector, Length
evaluate_surface = EvaluateSurface(Surface=surface, Point=surface_closest_point.UVPoint)  # -> Point, Normal, UDirection, VDirection, Frame
align_plane = AlignPlane(Plane=evaluate_surface.Frame, Direction=vector_2pt.Vector)  # -> Plane, Angle

offset_curve = OffsetCurve(
    Curve=list_item_2,
    Distance=Slider(0.06, range=0..0.1),
    Plane=align_plane.Plane,
    BothSides=True,
    Kinks=0,
    CapType=Slider(0, range=0..3))

plane_origin = PlaneOrigin(Base=align_plane.Plane, Origin=point_on_curve)
deconstruct_plane = DeconstructPlane(Plane=plane_origin)  # -> Origin, XAxis, YAxis, ZAxis

number_slider_7 = Slider(0.25, range=0..1.1)
fatten = Fatten(
    Skeleton=curve_3,
    Thickness=number_slider_7,
    LengthSubdivisions=Slider(0, range=0..10),
    EndType=Slider(0, range=0..10),
    AdjustForAngle=False)

number_slider_8 = Slider(0.1, range=0..0.1)
negative = Negative(Value=number_slider_7)
merge_2 = Merge(Data1=number_slider_7, Data2=negative)
line_sdl = LineSDL(Start=deconstruct_plane.Origin, Direction=deconstruct_plane.YAxis, Length=merge_2)

pipe = Pipe(Curve=line_sdl, Radius=Slider(0.076, range=0..0.1), Caps=1)

mesh_edges_2 = MeshEdges(Mesh=fatten)  # -> NakedEdges, InteriorEdges, NonManifoldEdges
collision_one_many = CollisionOneMany(Collider=flatten(mesh_edges_2.InteriorEdges), Obstacles=pipe)  # -> Collision, Index
cull_pattern = CullPattern(List=simplify(mesh_edges_2.InteriorEdges), CullPattern=collision_one_many.Collision)
shift_paths = ShiftPaths(Data=cull_pattern, Offset=-1)
loft = Loft(Curves=shift_paths, Options={Adjust=False, Closed=False, LoftEnds=0, LoftSimp=0, LoftType=0, Rebuild=10, Refit=0.01})
mesh = Mesh(<mesh referenced from the Rhino model>)
mesh_2 = Mesh(mesh_surface)
triangulate = Triangulate(Mesh=mesh_2)  # -> Mesh, Count

brep = Brep(<brep referenced from the Rhino model>)
settings_custom = SettingsCustom(
    StitchSeams=True,
    SimplePlanes=False,
    Refine=True,
    MinCount=16,
    MaxCount=400,
    AspectRatio=20,
    MaxDistance=0,
    MaxAngle=20,
    MinEdge=Slider(0.12, range=0..1),
    MaxEdge=Slider(0.24, range=0..1))
mesh_brep = MeshBrep(Brep=brep, Settings=settings_custom)

geometry_pipeline = GeometryPipeline(
    GroupByLayer=False,
    GroupByType=False,
    IncludeHidden=True,
    IncludeLocked=True,
    LayerFilter="Support",
    NameFilter="*",
    SublayerFiltering=True,
    TypeFilter=1073741848)

brep_2 = Brep(geometry_pipeline)
deconstruct_mesh = DeconstructMesh(Mesh=triangulate.Mesh)  # -> Vertices, Faces, Colours, Normals
point_in_breps = PointInBreps(Brep=brep_2, Point=deconstruct_mesh.Vertices, Strict=False)  # -> Inside, Index
cull_pattern_2 = CullPattern(List=deconstruct_mesh.Vertices, CullPattern=point_in_breps.Inside)

brep_3 = Brep(<brep referenced from the Rhino model>)
deconstruct_mesh_2 = DeconstructMesh(Mesh=triangulate.Mesh)  # -> Vertices, Faces, Colours, Normals
point_in_breps_2 = PointInBreps(Brep=brep_3, Point=deconstruct_mesh_2.Vertices, Strict=False)  # -> Inside, Index
cull_pattern_3 = CullPattern(List=deconstruct_mesh_2.Vertices, CullPattern=point_in_breps_2.Inside)

brep_4 = Brep(<brep referenced from the Rhino model>)
deconstruct_mesh_3 = DeconstructMesh(Mesh=triangulate.Mesh)  # -> Vertices, Faces, Colours, Normals
point_in_breps_3 = PointInBreps(Brep=brep_4, Point=deconstruct_mesh_3.Vertices, Strict=False)  # -> Inside, Index
cull_pattern_4 = CullPattern(List=deconstruct_mesh_3.Vertices, CullPattern=point_in_breps_3.Inside)

mesh_edges_3 = MeshEdges(Mesh=mesh_brep)  # -> NakedEdges, InteriorEdges, NonManifoldEdges
weld_mesh = WeldMesh(Mesh=mesh_brep, Angle=3.141592654)
nakedvertices = NakedVertices(Mesh=weld_mesh)  # -> ClothedIndex, NakedIndex, ClothedPts, NakedPts

geometry = Geometry(nakedvertices.NakedPts)
meshmachine = MeshMachine(
    Geometry=weld_mesh,
    Length=Slider(0.16, range=0..1),
    FixVertices=geometry,
    Flip=1,
    PullStrength=0.8,
    CurvatureAdaptivity=0,
    BoundaryScale=1,
    BoundaryDistance=5,
    Exponent=2,
    Background=0.5,
    Iterations=1,
    Reset=Toggle(False))
timer = Timer(TimerInterval=20, Target=meshmachine)  # disabled
planktonmesh = PlanktonMesh(meshmachine)
mesh_3 = Mesh(planktonmesh)
mesh_edges_4 = MeshEdges(Mesh=mesh_3)  # -> NakedEdges, InteriorEdges, NonManifoldEdges

# ---- group: Self Load Points(on all vertices)
geometry_2 = Geometry(deconstruct_mesh.Vertices)

# ---- group: Mesh Global Geometry
mesh_4 = Mesh(triangulate.Mesh)

# ---- group: Support Points
geometry_3 = Geometry(cull_pattern_2)

# ---- group: Load Points(external load)
geometry_4 = Geometry(cull_pattern_3)

# ----
toggle = BooleanToggle(True)
mat = MillC_StockSupportType(X=True, Y=True, Z=True, RX=toggle, RY=toggle, RZ=toggle)
fepointsupports = FEPointSupports(Point=geometry_3, SupportType=mat)

Z = UnitZ(Factor=Slider(-30, range=-10000..1))
fepointload = FEPointLoad(Point=geometry_2, Load=Z)

Z_2 = UnitZ(Factor=Slider(-100, range=-10000..1))
fepointload_2 = FEPointLoad(Point=geometry_4, Load=Z_2)

mat_2 = Material(MaterialType=2)
femesh = FEMesh(Meshes=mesh_4, Material=mat_2, Thickness=Slider(1, range=0..1), AreaLoad=Vector(0, 0, 0), NormalAreaLoad=0)

optimization_steps = Slider(5, range=0..5)
selfweight = Slider(1, range=0..1)
fea_system = FEASystem(
    ModelComponents=flatten([femesh, fepointsupports, fepointload, fepointload_2]),
    IntersectAddedCurves=True,
    MergeTolerance=0.0001,
    MinimumCurveSpan=0.05,
    MaximumCurveSpan=10000,
    CurveTolerance=0.1)
mesh_5 = Mesh(<mesh referenced from the Rhino model>)
fe_solver = FESolver(
    FEModel=fea_system,
    SelfWeightCoefficient=selfweight,
    BeamOptimisationIterations=0,
    QuadOptimisationIterations=optimization_steps,
    OptimizationTarget=0.3,
    OptimizationPenalization=1.5,
    LoadCase=0,
    AllCases=True)  # -> FEModel, MaxDeflection, Weight; disabled
weld_mesh_2 = WeldMesh(Mesh=mesh_5, Angle=3.141592654)
weaverbird_s_naked_boundary = WeaverbirdsNakedBoundary(MeshClosedPolylines=weld_mesh_2)

panel = Panel("visualization")
division = Division(A=Slider(0, range=0..101), B=fe_solver.MaxDeflection)
mesh_visualization = MeshVisualization(FEModel=fe_solver.FEModel, Deflection=division, Plane=1, ShowThickness=Toggle(False), ColorMode=8)  # -> Mesh, CompleteRange, VisibleRange

mesh_edges_5 = MeshEdges(Mesh=weld_mesh_2)  # -> NakedEdges, InteriorEdges, NonManifoldEdges
deconstruct_mesh_4 = DeconstructMesh(Mesh=weld_mesh_2)  # -> Vertices, Faces, Colours, Normals

stress_pattern = StressPattern(
    FEModel=fe_solver.FEModel,
    Omega=Slider(5, range=0..5),
    Scalefield=Toggle(True),
    Uselambda=Toggle(False),
    Smoothfactor=Toggle(False),
    SmoothModulo=1,
    Iterations=Slider(0, range=0..5000),
    MeshDenisty=1,
    Layer=Slider(1, range=-1..1),
    Thickness=0,
    Bending=Toggle(False))
crv = Curve([<curve referenced from the Rhino model> x4])
pattern = Pattern(System=stress_pattern, Pattern=crv)  # -> Patterns, PatternPoints

join_curves = JoinCurves(Curves=mesh_edges_5.NakedEdges, Preserve=False)
control_points = ControlPoints(Curve=join_curves)  # -> Points, Weights, Knots
removeduplicatepts = RemoveDuplicatePts(Points=control_points.Points, Tolerance=0.01)

number_slider_9 = Slider(0.073, range=0..0.1)

quad_results = QuadResults(FEModel=fe_solver.FEModel, Plane=1)  # -> PrincipalStressFrame, Area, NormalDisplacement, MaxVonMisesStress, PS1, PS2, StiffnessMultiplier, Bending
stresslines = StressLines(FEModel=fe_solver.FEModel, Points=quad_results.PrincipalStressFrame, Plane=1)  # -> Stress1, Stress2

negative_2 = Negative(Value=number_slider_9)
merge_3 = Merge(Data1=negative_2, Data2=number_slider_9)  # -> graft(Result)
unit_z = UnitZ(Factor=merge_3)  # -> simplify(UnitVector)

panel_2 = Panel("visualization of thickness")
slider = Slider(-1, range=-1..61)
c_script = CSharpScript(m=mesh_visualization.Mesh)  # -> out, A; inputs m: Mesh, dh: Double
# ---------- c_script: C# usings ----------
using System.IO;
using System.Linq;
using System.Data;
using System.Drawing;
using System.Reflection;
using System.Windows.Forms;
using System.Xml;
using System.Xml.Linq;
using System.Runtime.InteropServices;

using Rhino.DocObjects;
using Rhino.Collections;
using GH_IO;
using GH_IO.Serialization;
# ---------- c_script: C# ----------
    m.FaceNormals.ComputeFaceNormals();
    m.Normals.ComputeNormals();

    for(int i = 0; i < m.Vertices.Count; ++i) {
      Point3d p = new Point3d(m.Vertices[i]);
      Vector3d n = new Vector3d(m.Normals[i]);

      m.Vertices.SetVertex(i, p + n * dh * m.TextureCoordinates[i].X);
    }

    m.VertexColors.Clear();

    m.FaceNormals.ComputeFaceNormals();
    m.Normals.ComputeNormals();


    A = m;
# ---------- end c_script ----------

closest_point = ClosestPoint(Point=deconstruct_mesh_4.Vertices, Cloud=flatten(removeduplicatepts))  # -> ClosestPoint, CPIndex, Distance
larger_than = LargerThan(FirstNumber=closest_point.Distance, SecondNumber=0)  # -> LargerThan, OrEqualTo
dispatch = Dispatch(List=deconstruct_mesh_4.Vertices, DispatchPattern=larger_than.LargerThan)  # -> ListA, ListB

preview = CustomPreview(Geometry=c_script.A, Shader=ColourSwatch(SwatchColor=RGB(255, 255, 255)))

preview_2 = CustomPreview(Geometry=stresslines.Stress1, Shader=ColourSwatch(SwatchColor=RGBA(255, 3, 255, 177)))

preview_3 = CustomPreview(Geometry=pattern.Patterns, Shader=ColourSwatch(SwatchColor=RGB(0, 0, 0)))

move = Move(Geometry=dispatch.ListA, Motion=unit_z)  # -> simplify(Geometry), Transform
weave = Weave(Pattern=larger_than.LargerThan, Stream0=dispatch.ListB, Stream1=move.Geometry, NullGaps=False)  # -> simplify(Weave)
construct_mesh = ConstructMesh(Vertices=weave, Faces=deconstruct_mesh_4.Faces)  # -> simplify(Mesh)
explode_tree = ExplodeTree(Data=construct_mesh)  # -> Branch0, Branch1
mesh_flip = MeshFlip(Mesh=explode_tree.Branch0)
merge_4 = Merge(Data1=mesh_flip, Data2=explode_tree.Branch1)  # -> flatten(Result)
mesh_join = MeshJoin(Meshes=merge_4)
mesh_6 = Mesh(mesh_join)
weld_mesh_3 = WeldMesh(Mesh=mesh_6, Angle=3.141592654)
unify_mesh = UnifyMesh(Mesh=weld_mesh_3)  # -> Result, Count

brep_5 = Brep([<brep referenced from the Rhino model> x2])
deconstruct_mesh_5 = DeconstructMesh(Mesh=unify_mesh.Result)  # -> Vertices, Faces, Colours, Normals
point_in_breps_4 = PointInBreps(Brep=brep_5, Point=deconstruct_mesh_5.Vertices, Strict=False)  # -> Inside, Index
dispatch_2 = Dispatch(List=deconstruct_mesh_5.Vertices, DispatchPattern=point_in_breps_4.Inside)  # -> ListA, ListB

mesh_edges_6 = MeshEdges(Mesh=unify_mesh.Result)  # -> NakedEdges, InteriorEdges, NonManifoldEdges
multiplication = Multiplication(A=deconstruct_mesh_5.Normals, B=Slider(0.005, range=0..0.01))
geometry_5 = Geometry([mesh_edges_6.NakedEdges, mesh_edges_6.InteriorEdges])
vector_display = VectorDisplay(Anchor=deconstruct_mesh_5.Vertices, Vector=multiplication)
number_slider_10 = Slider(0, range=0..1)

mesh_volume = MeshVolume(Mesh=unify_mesh.Result)  # -> Volume, Centroid
multiplication_2 = Multiplication(A=mesh_volume.Volume, B=Slider(10, range=0..10))

number_slider_11 = Slider(0.051, range=0..1)  # disabled
length_2 = Length(Curve=geometry_5)  # disabled
multiplication_3 = Multiplication(A=length_2, B=number_slider_11)  # disabled
clamplength = ClampLength(Line=geometry_5, LowerLimit=length_2, UpperLimit=multiplication_3, Strength=1)  # disabled

pt = Point(dispatch_2.ListA)
subtraction_2 = Subtraction(A=Slider(1, range=0..1), B=number_slider_10)

number_slider_12 = Slider(0.029, range=0.005..0.25)
sort_duplicate_points = SortDuplicatePoints(Points=dispatch_2.ListB)  # -> UniquePoints, Indices
spherecollide = SphereCollide(Points=sort_duplicate_points.UniquePoints, Radius=number_slider_12, Strength=Slider(7810, range=0..10000))

multiplication_4 = Multiplication(A=number_slider_10, B=multiplication_2)
negative_3 = Negative(Value=subtraction_2)
grab = Grab(On=Toggle(True), Strength=Slider(5000, range=0..10000), Range=3)  # -> Grab, Anchors
volume = Volume(Mesh=unify_mesh.Result, Volume=multiplication_4, Strength=Slider(500, range=0..1000))
anchor = Anchor(Point=pt, Strength=Slider(10000, range=0..10000))
length_line = LengthLine(Line=geometry_5, Strength=Slider(500, range=0..1000))
floor = Floor(Strength=Slider(500, range=0..1000))
vertexloads = VertexLoads(Mesh=unify_mesh.Result, Strength=negative_3)
show = Show(G=unify_mesh.Result)
multiplication_5 = Multiplication(A=number_slider_10, B=Slider(181, range=0..181))

pressure = Pressure(M=unify_mesh.Result, Strength=multiplication_5)

solver = Solver(
    GoalObjects=flatten([show, length_line, pressure, anchor, floor, vertexloads, spherecollide, grab.Grab, volume]),
    Reset=Button(),
    Threshold=1e-15,
    Tolerance=0.01,
    On=Toggle(False))  # -> I, V, O
mesh_7 = Mesh(solver.O)
deconstruct_mesh_6 = DeconstructMesh(Mesh=mesh_7)  # -> Vertices, Faces, Colours, Normals
weaverbird_s_loop_subdivision = WeaverbirdsLoopSubdivision(MeshCurves=mesh_7, Level=1, SmoothNakedEdges=1)
mesh_sphere = MeshSphere(Base=deconstruct_mesh_6.Vertices, Radius=number_slider_12, UCount=10, VCount=20)
mesh_edges_7 = MeshEdges(Mesh=weaverbird_s_loop_subdivision)  # -> NakedEdges, InteriorEdges, NonManifoldEdges
geometry_6 = Geometry(flatten([mesh_edges_7.NakedEdges, mesh_edges_7.InteriorEdges]))
